# Grasshopper definition BEP cable-stayed bridge.gh (Grasshopper 1.0.7)
# plug-ins: Pufferfish, BullAnt, ggGHgsa, Bifocals, Kangaroo2 Components, Mesh Pipe

number_slider = Slider(5460, range=0..10000)
neg = Negative(Value=Slider(0, range=0..10000))
subtraction = Subtraction(A=number_slider, B=Slider(600, range=0..1000))
matrix_end = ConstructPoint(XCoordinate=neg, YCoordinate=Slider(32600, range=0..100000), ZCoordinate=subtraction)
gaslab_end = ConstructPoint(XCoordinate=Slider(18500, range=0..100000), YCoordinate=0, ZCoordinate=number_slider)

number_slider_2 = Slider(0.647, range=0..1)
deveation_from_center = Slider(-2150, range=-3000..3000)
structural_height = Slider(11000, range=0..20000)
triangel_spread = Slider(1.34, range=1.1..1.6)

Y = UnitY(Factor=1)
X = UnitX(Factor=1)
neg_2 = Negative(Value=Y)

number_slider_3 = Slider(0.647, range=0..1)
deveation_from_center_2 = Slider(-2150, range=-3000..3000)
triangel_spread_2 = Slider(1.34, range=1.1..1.6)
structural_height_2 = Slider(11000, range=0..20000)

# ----
# Unit Y
# Unit X
# Unit Z
# Relay
# Point
# Negative
biarc = BiArc(StartPoint=matrix_end, StartTangent=neg_2, EndPoint=gaslab_end, EndTangent=X, Ratio=Slider(0.4866, range=0..1))  # -> FirstArc, SecondArc, BiArc
join = JoinCurves(Curves=[biarc.FirstArc, biarc.SecondArc], Preserve=False)
flip = FlipCurve(Curve=biarc.FirstArc)  # -> Curve, Flag
# Fractal bridge
curvepoint = PointOnCurve([biarc.SecondArc, flip.Curve], parameter=0.064)

# ----
# Buildings
number_slider_4 = Slider(18500, range=0..100000)
number_slider_5 = Slider(20100, range=0..100000)
number_slider_6 = Slider(12500, range=0..100000)
number_slider_7 = Slider(13500, range=0..100000)
pt = ConstructPoint(XCoordinate=number_slider_4, YCoordinate=Slider(32600, range=0..100000), ZCoordinate=0)
pt_2 = ConstructPoint(XCoordinate=0, YCoordinate=number_slider_5, ZCoordinate=0)
pt_3 = ConstructPoint(XCoordinate=number_slider_6, YCoordinate=number_slider_5, ZCoordinate=0)
pt_4 = ConstructPoint(XCoordinate=0, YCoordinate=number_slider_7, ZCoordinate=0)
pt_5 = ConstructPoint(XCoordinate=number_slider_4, YCoordinate=number_slider_5, ZCoordinate=0)
pt_6 = ConstructPoint(XCoordinate=number_slider_6, YCoordinate=0, ZCoordinate=0)
pt_7 = ConstructPoint(XCoordinate=number_slider_6, YCoordinate=number_slider_7, ZCoordinate=0)
parking_lot = Rectangle2Pt(Plane=PlaneXY(0, 0, 0), PointA=pt_4, PointB=pt_3, Radius=0)  # -> Rectangle, Length
parking_lot_2 = Rectangle2Pt(Plane=PlaneXY(0, 0, 0), PointA=Point(0, 0, 0), PointB=pt_7, Radius=0)  # -> Rectangle, Length
parking_lot_3 = Rectangle2Pt(Plane=PlaneXY(0, 0, 0), PointA=pt_6, PointB=pt_5, Radius=0)  # -> Rectangle, Length
bycicle_lot = Rectangle2Pt(Plane=PlaneXY(0, 0, 0), PointA=pt_2, PointB=pt, Radius=0)  # -> Rectangle, Length
street = Merge(Data1=parking_lot.Rectangle, Data2=parking_lot_3.Rectangle)

column_angle = Slider(4111, range=0..10000)
# Site layout
number_slider_8 = Slider(100, range=0..100)
divide = DivideCurve(Curve=join, Count=Slider(2, range=0..10), Kinks=False)  # -> Points, Tangents, Parameters
pframe = PerpFrame(Curve=join, Parameter=divide.Parameters)
division = Division(A=number_slider_8, B=1000)
item = ListItem(List=divide.Points, Index=0, Wrap=True)  # -> Item, Item1
item_2 = ListItem(List=pframe, Index=Slider(1, range=0..1), Wrap=True)
dom = ConstructDomain(DomainStart=0, DomainEnd=number_slider_8)
project = Project(Geometry=item.Item1, Plane=PlaneXY(0, 0, 0))  # -> Geometry, Transform
deplane = DeconstructPlane(Plane=item_2)  # -> Origin, XAxis, YAxis, ZAxis
multiplication = Multiplication(A=column_angle, B=deplane.XAxis)
X_2 = UnitX(Factor="383")
move = Move(Geometry=project.Geometry, Motion=X_2)  # -> Geometry, Transform
ln = Line(StartPoint=curvepoint, EndPoint=move.Geometry)

# ----
# Bridge points
number_slider_9 = Slider(32600, range=0..100000)
matrix_end_2 = ConstructPoint(XCoordinate=0, YCoordinate=number_slider_9, ZCoordinate=Slider(3900, range=0..10000))
origin = ConstructPoint(XCoordinate=0, YCoordinate=0, ZCoordinate=Slider(4200, range=0..10000))
gaslab_end_2 = ConstructPoint(XCoordinate=Slider(18500, range=0..100000), YCoordinate=0, ZCoordinate=Slider(4500, range=0..10000))

ext = ExtendCurve(Curve=ln, Type=0, Start=structural_height_2, End=Slider(0, range=0..100))
explode = Explode(Curve=ext, Recursive=True)  # -> Segments, Vertices
item_3 = ListItem(List=flatten(explode.Vertices), Index=0, Wrap=True)  # -> Item, Item1, Item2, Item3
gaslab_end_3 = ConstructPoint(XCoordinate=Slider(18500, range=0..100000), YCoordinate=0, ZCoordinate=Slider(7000, range=0..10000))
matrix_end_3 = ConstructPoint(XCoordinate=0, YCoordinate=Slider(32600, range=0..100000), ZCoordinate=Slider(6400, range=0..10000))
# Fractal bridge
# Fractal bridge
number_slider_10 = Slider(200, range=0..1000)
move_2 = Move(Geometry=[item_3.Item, item_3.Item3], Motion=multiplication)  # -> Geometry, Transform
crv_cp = CurveClosestPoint(Point=curvepoint, Curve=join)  # -> Point, Parameter, Distance
Y_2 = UnitY(Factor=1)
Y_3 = UnitY(Factor=1)
ln_2 = Line(StartPoint=move_2.Geometry, EndPoint=move.Geometry)
X_3 = UnitX(Factor=1)
X_4 = UnitX(Factor=1)
shatter = Shatter(Curve=join, Parameters=crv_cp.Parameter)
neg_3 = Negative(Value=Y_2)
neg_4 = Negative(Value=Y_3)
pipe = Pipe(Curve=ln_2, Radius=number_slider_10, Caps=0)
crv_cp_2 = CurveClosestPoint(Point=curvepoint, Curve=ln_2)  # -> Point, Parameter, Distance
explode_2 = Explode(Curve=ln_2, Recursive=True)  # -> Segments, Vertices
biarc_2 = BiArc(StartPoint=matrix_end_2, StartTangent=neg_3, EndPoint=gaslab_end_2, EndTangent=X_3, Ratio=Slider(0.514, range=0..1))  # -> FirstArc, SecondArc, BiArc
biarc_3 = BiArc(StartPoint=matrix_end_3, StartTangent=neg_4, EndPoint=gaslab_end_3, EndTangent=X_4, Ratio=Slider(0.52, range=0..1))  # -> FirstArc, SecondArc, BiArc
ln_3 = Line(StartPoint=item_3.Item, EndPoint=item_3.Item3)
item_4 = ListItem(List=shatter, Index=0, Wrap=True)  # -> Item, Item1, Item2
item_5 = ListItem(List=flatten(explode_2.Vertices), Index=0, Wrap=True)  # -> Item, Item1, Item2
len = Length(Curve=ln_3)
flip_2 = FlipCurve(Curve=item_4.Item)  # -> Curve, Flag
number_slider_11 = Slider(6400, range=0..10000)
number_slider_12 = Slider(32600, range=0..100000)
number_slider_13 = Slider(1000, range=0..10000)
number_slider_14 = Slider(1000, range=0..10000)
division_2 = Division(A=len, B=triangel_spread_2)
ln_4 = Line(StartPoint=item_5.Item, EndPoint=item_5.Item2)
neg_5 = Negative(Value=Slider(4173, range=0..50000))
neg_6 = Negative(Value=number_slider_13)
neg_7 = Negative(Value=number_slider_14)
pt_8 = ConstructPoint(XCoordinate=Slider(0, range=0..100000), YCoordinate=Slider(11446, range=0..100000), ZCoordinate=0)
pt_9 = ConstructPoint(XCoordinate=neg_5, YCoordinate=Slider(11353, range=0..100000), ZCoordinate=Slider(17912, range=0..100000))
pt_10 = ConstructPoint(XCoordinate=Slider(0, range=0..100000), YCoordinate=Slider(14072, range=0..100000), ZCoordinate=0)
pt_11 = ConstructPoint(
    XCoordinate=Slider(9105, range=0..50000),
    YCoordinate=Slider(17512, range=0..100000),
    ZCoordinate=Slider(20000, range=0..100000))
ln_5 = Line(StartPoint=pt_8, EndPoint=pt_9)
matrix_end_4 = ConstructPoint(XCoordinate=number_slider_13, YCoordinate=number_slider_12, ZCoordinate=number_slider_11)
matrix_end_5 = ConstructPoint(XCoordinate=neg_6, YCoordinate=number_slider_12, ZCoordinate=number_slider_11)
gaslab_end_4 = ConstructPoint(XCoordinate=Slider(18500, range=0..100000), YCoordinate=number_slider_14, ZCoordinate=Slider(7000, range=0..10000))
ln_6 = Line(StartPoint=pt_10, EndPoint=pt_11)
gaslab_end_5 = ConstructPoint(XCoordinate=Slider(18500, range=0..100000), YCoordinate=neg_7, ZCoordinate=Slider(7000, range=0..10000))
pipe_2 = Pipe(Curve=ln_5, Radius=Slider(250, range=0..1000), Caps=0)
pipe_3 = Pipe(Curve=ln_6, Radius=Slider(250, range=0..1000), Caps=0)

divdist = DivideDistance(Curve=[item_4.Item2, flip_2.Curve], Distance=division_2)  # -> Points, Tangents, Parameters
pframe_2 = PerpFrame(Curve=item_4.Item2, Parameter=divdist.Parameters)  # -> flatten(Frame)
pframe_3 = PerpFrame(Curve=flip_2.Curve, Parameter=divdist.Parameters)  # -> flatten(Frame)
hframe = HorizontalFrame(Curve=item_4.Item2, Parameter=divdist.Parameters)  # -> flatten(Frame)
item_6 = ListItem(List=divdist.Points, Index=Slider(1, range=0..10), Wrap=True)
hframe_2 = HorizontalFrame(Curve=flip_2.Curve, Parameter=divdist.Parameters)  # -> flatten(Frame)
clean = CleanTree(RemoveNulls=True, RemoveInvalid=True, RemoveEmpty=False, Tree=pframe_2)
clean_2 = CleanTree(RemoveNulls=True, RemoveInvalid=True, RemoveEmpty=False, Tree=pframe_3)
item_7 = ListItem(List=hframe, Index=Slider(1, range=0..11), Wrap=True)
item_8 = ListItem(List=hframe_2, Index=Slider(5, range=0..11), Wrap=True)
item_9 = ListItem(List=clean, Index=Slider(1, range=0..1), Wrap=True)
item_10 = ListItem(List=clean_2, Index=Slider(1, range=0..1), Wrap=True)
prot = RotatePlane(Plane=item_8, Angle=degrees(Slider(180, range=0..1000)))
deplane_2 = DeconstructPlane(Plane=[item_7, prot])  # -> Origin, XAxis, YAxis, ZAxis
multiplication_2 = Multiplication(A=deveation_from_center_2, B=deplane_2.YAxis)
move_3 = Move(Geometry=item_6, Motion=multiplication_2)  # -> flatten(Geometry), Transform
panel = Panel("""0
3""")
item_11 = ListItem(List=explode_2.Vertices, Index=0, Wrap=True)
item_12 = ListItem(List=move_3.Geometry, Index=panel, Wrap=True)  # -> graft(Item)
ln_7 = Line(StartPoint=item_12, EndPoint=item_11)  # -> flatten(Line)
item_13 = ListItem(List=ln_7, Index=0, Wrap=True)  # -> Item, Item1
mirror = Mirror(Geometry=item_13.Item, Plane=item_9)  # -> Geometry, Transform
mirror_2 = Mirror(Geometry=item_13.Item1, Plane=item_10)  # -> Geometry, Transform
scale = Scale(Geometry=[mirror_2.Geometry, mirror.Geometry], Center=item_12, Factor=number_slider_3)  # -> flatten(Geometry), Transform
explode_3 = Explode(Curve=[mirror_2.Geometry, mirror.Geometry, item_13.Item, item_13.Item1], Recursive=True)  # -> Segments, flatten(Vertices)
item_14 = ListItem(List=scale.Geometry, Index=0, Wrap=True)  # -> Item, Item1, Item2
item_15 = ListItem(List=move_3.Geometry, Index=Slider(3, range=0..10), Wrap=True)
end = EndPoints(Curve=item_14.Item2)  # -> Start, End
ln_8 = Line(StartPoint=item_15, EndPoint=end.End)
item_16 = ListItem(List=explode_3.Vertices, Index=0, Wrap=True)  # -> Item, Item1, Item2, Item3, Item4, Item5, Item6, Item7
panel_2 = Panel("""1
2""")
replace = ReplaceItems(List=scale.Geometry, Item=ln_8, Indices=Slider(2, range=0..10), Wrap=False)
ln_9 = Line(StartPoint=item_16.Item1, EndPoint=item_16.Item7)
ln_10 = Line(StartPoint=item_16.Item5, EndPoint=item_16.Item3)
item_17 = ListItem(List=replace, Index=panel_2, Wrap=True)

len_2 = Length(Curve=[ln_10, ln_9])
item_18 = ListItem(List=divdist.Points, Index=0, Wrap=True)  # -> Item, flatten(Item1)
division_3 = Division(A=len_2, B=triangel_spread_2)
explode_4 = Explode(Curve=item_17, Recursive=True)  # -> Segments, Vertices
crv_cp_3 = CurveClosestPoint(Point=item_18.Item1, Curve=biarc.SecondArc)  # -> Point, Parameter, Distance
crv_cp_4 = CurveClosestPoint(Point=item_18.Item1, Curve=flip.Curve)  # -> Point, Parameter, Distance
item_19 = ListItem(List=explode_4.Vertices, Index=0, Wrap=True)  # -> Item, Item1, Item2, Item3
ln_11 = Line(StartPoint=item_19.Item3, EndPoint=[item_16.Item7, item_16.Item5])  # -> flatten(Line)
shatter_2 = Shatter(Curve=biarc.SecondArc, Parameters=crv_cp_3.Parameter)
shatter_3 = Shatter(Curve=flip.Curve, Parameters=crv_cp_4.Parameter)
panel_3 = Panel("""1
2""")
item_20 = ListItem(List=shatter_2, Index=Slider(1, range=0..3), Wrap=True)
item_21 = ListItem(List=shatter_3, Index=Slider(1, range=0..3), Wrap=True)
item_22 = ListItem(List=ln_11, Index=panel_3, Wrap=True)
divdist_2 = DivideDistance(Curve=[item_20, item_21], Distance=division_3)  # -> Points, Tangents, Parameters
item_23 = ListItem(List=divdist_2.Points, Index=Slider(1, range=0..3), Wrap=True)
pframe_4 = PerpFrame(Curve=item_20, Parameter=divdist_2.Parameters)  # -> flatten(Frame)
pframe_5 = PerpFrame(Curve=item_21, Parameter=divdist_2.Parameters)  # -> flatten(Frame)
hframe_3 = HorizontalFrame(Curve=item_20, Parameter=divdist_2.Parameters)  # -> flatten(Frame)
hframe_4 = HorizontalFrame(Curve=item_21, Parameter=divdist_2.Parameters)  # -> flatten(Frame)
clean_3 = CleanTree(RemoveNulls=True, RemoveInvalid=True, RemoveEmpty=False, Tree=pframe_4)
clean_4 = CleanTree(RemoveNulls=True, RemoveInvalid=True, RemoveEmpty=False, Tree=pframe_5)
item_24 = ListItem(List=hframe_4, Index=Slider(5, range=0..10), Wrap=True)
item_25 = ListItem(List=hframe_3, Index=Slider(1, range=0..1), Wrap=True)
item_26 = ListItem(List=clean_3, Index=0, Wrap=True)  # -> Item, Item1
item_27 = ListItem(List=clean_4, Index=0, Wrap=True)  # -> Item, Item1
prot_2 = RotatePlane(Plane=item_24, Angle=degrees(Slider(180, range=0..1000)))
deplane_3 = DeconstructPlane(Plane=[prot_2, item_25])  # -> Origin, XAxis, YAxis, ZAxis
neg_8 = Negative(Value=deveation_from_center_2)
multiplication_3 = Multiplication(A=neg_8, B=deplane_3.YAxis)
move_4 = Move(Geometry=item_23, Motion=multiplication_3)  # -> flatten(Geometry), Transform
panel_4 = Panel("""1
2""")
item_28 = ListItem(List=move_4.Geometry, Index=panel_4, Wrap=True)
ln_12 = Line(StartPoint=item_19.Item3, EndPoint=item_28)  # -> flatten(Line)
panel_5 = Panel("""0
3""")
item_29 = ListItem(List=ln_12, Index=panel_5, Wrap=True)
mirror_3 = Mirror(Geometry=item_29, Plane=[item_26.Item1, item_27.Item1])  # -> Geometry, Transform
scale_2 = Scale(Geometry=mirror_3.Geometry, Center=item_28, Factor=number_slider_3)  # -> flatten(Geometry), Transform
explode_5 = Explode(Curve=[item_29, mirror_3.Geometry], Recursive=True)  # -> Segments, flatten(Vertices)
panel_6 = Panel("""0
3""")
item_30 = ListItem(List=explode_5.Vertices, Index=0, Wrap=True)  # -> Item, Item1, Item2, Item3, Item4, Item5, Item6
item_31 = ListItem(List=scale_2.Geometry, Index=panel_6, Wrap=True)
ln_13 = Line(StartPoint=item_30.Item4, EndPoint=item_30.Item)
ln_14 = Line(StartPoint=item_30.Item6, EndPoint=item_30.Item2)

# ----
# Tension cable extension adjustment
item_32 = ListItem(List=divdist_2.Points, Index=0, Wrap=True)  # -> Item, flatten(Item1)
crv_cp_5 = CurveClosestPoint(Point=item_32.Item1, Curve=biarc.SecondArc)  # -> Point, Parameter, Distance
crv_cp_6 = CurveClosestPoint(Point=item_32.Item1, Curve=flip.Curve)  # -> Point, Parameter, Distance
shatter_4 = Shatter(Curve=biarc.SecondArc, Parameters=crv_cp_5.Parameter)
shatter_5 = Shatter(Curve=flip.Curve, Parameters=crv_cp_6.Parameter)
len_3 = Length(Curve=[ln_13, ln_14])
item_33 = ListItem(List=shatter_4, Index=Slider(1, range=0..10), Wrap=True)
division_4 = Division(A=len_3, B=triangel_spread_2)
item_34 = ListItem(List=shatter_5, Index=Slider(1, range=0..10), Wrap=True)
divdist_3 = DivideDistance(Curve=[item_33, item_34], Distance=division_4)  # -> Points, Tangents, Parameters
explode_6 = Explode(Curve=item_31, Recursive=True)  # -> Segments, Vertices
item_35 = ListItem(List=flatten(explode_6.Vertices), Index=0, Wrap=True)  # -> Item, Item1, Item2
pframe_6 = PerpFrame(Curve=item_33, Parameter=divdist_3.Parameters)  # -> flatten(Frame)
item_36 = ListItem(List=divdist_3.Points, Index=Slider(1, range=0..10), Wrap=True)
item_37 = ListItem(List=explode_6.Vertices, Index=0, Wrap=True)
pframe_7 = PerpFrame(Curve=item_34, Parameter=divdist_3.Parameters)  # -> flatten(Frame)
hframe_5 = HorizontalFrame(Curve=item_33, Parameter=divdist_3.Parameters)  # -> flatten(Frame)
hframe_6 = HorizontalFrame(Curve=item_34, Parameter=divdist_3.Parameters)  # -> flatten(Frame)
# Tension cable extension adjustment
# Tension cable extension adjustment
number_slider_15 = Slider(1134, range=0..1500)
number_slider_16 = Slider(563, range=0..2000)
ln_15 = Line(StartPoint=flatten(item_37), EndPoint=[item_30.Item, item_30.Item2])
clean_5 = CleanTree(RemoveNulls=True, RemoveInvalid=True, RemoveEmpty=False, Tree=pframe_6)
clean_6 = CleanTree(RemoveNulls=True, RemoveInvalid=True, RemoveEmpty=False, Tree=pframe_7)
item_38 = ListItem(List=hframe_6, Index=Slider(5, range=0..10), Wrap=True)
item_39 = ListItem(List=hframe_5, Index=Slider(1, range=0..1), Wrap=True)
item_40 = ListItem(List=clean_5, Index=Slider(1, range=0..1), Wrap=True)
item_41 = ListItem(List=clean_6, Index=Slider(1, range=0..1), Wrap=True)
prot_3 = RotatePlane(Plane=item_38, Angle=degrees(Slider(180, range=0..1000)))
Y_4 = UnitY(Factor=number_slider_16)
X_5 = UnitX(Factor=number_slider_16)
neg_9 = Negative(Value=number_slider_15)
vec = VectorXYZ(XComponent=X_5, YComponent=Y_4, ZComponent=0)  # -> Vector, Length
deplane_4 = DeconstructPlane(Plane=[prot_3, item_39])  # -> Origin, XAxis, YAxis, ZAxis
X_6 = UnitX(Factor=neg_9)
neg_10 = Negative(Value=vec.Vector)
move_5 = Move(Geometry=item_35.Item2, Motion=X_6)  # -> Geometry, Transform
move_6 = Move(Geometry=item_35.Item, Motion=neg_10)  # -> Geometry, Transform
multiplication_4 = Multiplication(A=deveation_from_center_2, B=deplane_4.YAxis)
ln_16 = Line(StartPoint=item_28, EndPoint=graft([move_5.Geometry, move_6.Geometry]))  # -> flatten(Line)
move_7 = Move(Geometry=item_36, Motion=multiplication_4)  # -> flatten(Geometry), Transform
panel_7 = Panel("""1
2""")
panel_8 = Panel("""1
2""")
item_42 = ListItem(List=ln_16, Index=panel_7, Wrap=True)
item_43 = ListItem(List=move_7.Geometry, Index=panel_8, Wrap=True)
ln_17 = Line(StartPoint=flatten([move_6.Geometry, move_5.Geometry]), EndPoint=[item_30.Item, item_30.Item2])
ln_18 = Line(StartPoint=flatten([move_6.Geometry, move_5.Geometry]), EndPoint=item_43)
mirror_4 = Mirror(Geometry=ln_18, Plane=[item_40, item_41])  # -> Geometry, Transform
scale_3 = Scale(Geometry=mirror_4.Geometry, Center=item_43, Factor=number_slider_3)  # -> flatten(Geometry), Transform
item_44 = ListItem(List=ln_18, Index=0, Wrap=True)  # -> Item, Item1
item_45 = ListItem(List=scale_3.Geometry, Index=0, Wrap=True)  # -> Item, Item1
explode_7 = Explode(Curve=ln_18, Recursive=True)  # -> Segments, Vertices
end_2 = EndPoints(Curve=item_45.Item1)  # -> Start, End
end_3 = EndPoints(Curve=item_44.Item1)  # -> Start, End
ln_19 = Line(StartPoint=end_2.Start, EndPoint=end_3.End)
item_46 = ListItem(List=explode_7.Vertices, Index=0, Wrap=True)  # -> flatten(Item)
replace_2 = ReplaceItems(List=scale_3.Geometry, Item=ln_19, Indices=Slider(1, range=0..1), Wrap=False)

item_47 = ListItem(List=divdist_3.Points, Index=0, Wrap=True)  # -> Item, flatten(Item1)
crv_cp_7 = CurveClosestPoint(Point=item_47.Item1, Curve=biarc.SecondArc)  # -> Point, Parameter, Distance
crv_cp_8 = CurveClosestPoint(Point=item_47.Item1, Curve=flip.Curve)  # -> Point, Parameter, Distance
shatter_6 = Shatter(Curve=biarc.SecondArc, Parameters=crv_cp_7.Parameter)
shatter_7 = Shatter(Curve=flip.Curve, Parameters=crv_cp_8.Parameter)
item_48 = ListItem(List=shatter_6, Index=Slider(1, range=0..10), Wrap=True)
item_49 = ListItem(List=shatter_7, Index=Slider(1, range=0..10), Wrap=True)
end_4 = EndPoints(Curve=item_48)  # -> Start, End
end_5 = EndPoints(Curve=item_49)  # -> Start, End
explode_8 = Explode(Curve=replace_2, Recursive=True)  # -> Segments, Vertices
pl = ConstructPlane(Origin=end_4.End, XAxis=Vector(1, 0, 0), YAxis=Vector(0, 1, 0))
pl_2 = ConstructPlane(Origin=end_5.End, XAxis=Vector(1, 0, 0), YAxis=Vector(0, 1, 0))
item_50 = ListItem(List=explode_8.Vertices, Index=0, Wrap=True)
prot_4 = RotatePlane(Plane=pl_2, Angle=degrees(Slider(270, range=0..300)))
neg_11 = Negative(Value=deveation_from_center_2)
deplane_5 = DeconstructPlane(Plane=[pl, prot_4])  # -> Origin, XAxis, YAxis, ZAxis
ln_20 = Line(StartPoint=item_46, EndPoint=flatten(item_50))
multiplication_5 = Multiplication(A=deveation_from_center_2, B=deplane_5.YAxis)
multiplication_6 = Multiplication(A=deplane_5.YAxis, B=neg_11)
move_8 = Move(Geometry=flatten([end_4.End, end_5.End]), Motion=multiplication_5)  # -> graft(Geometry), Transform
move_9 = Move(Geometry=flatten([end_4.End, end_5.End]), Motion=multiplication_6)  # -> graft(Geometry), Transform
ln_21 = Line(StartPoint=move_8.Geometry, EndPoint=item_50)
ln_22 = Line(StartPoint=move_9.Geometry, EndPoint=item_50)

divide_2 = DivideCurve(Curve=join, Count=Slider(2, range=0..10), Kinks=False)  # -> Points, Tangents, Parameters
item_51 = ListItem(List=divide_2.Points, Index=0, Wrap=True)  # -> Item, Item1
item_52 = ListItem(List=divide_2.Parameters, Index=0, Wrap=True)  # -> Item, Item1
hframe_7 = HorizontalFrame(Curve=join, Parameter=item_52.Item1)
deplane_6 = DeconstructPlane(Plane=hframe_7)  # -> Origin, XAxis, YAxis, ZAxis
multiplication_7 = Multiplication(A=Slider(950, range=-3000..3000), B=deplane_6.YAxis)
move_10 = Move(Geometry=item_51.Item1, Motion=multiplication_7)  # -> Geometry, Transform

item_53 = ListItem(List=flatten(move_9.Geometry), Index=Slider(1, range=0..1), Wrap=True)
item_54 = ListItem(List=flatten(move_9.Geometry), Index=0, Wrap=True)
pt_12 = Point(flatten([item_12, item_43, crv_cp_2.Point, item_53, item_28]))
pdecon = Deconstruct(Point=pt_12)  # -> XComponent, YComponent, ZComponent
sort = SortList(Keys=pdecon.YComponent, ValuesA=pt_12)  # -> Keys, ValuesA
ins = InsertItems(List=sort.ValuesA, Item=item_54, Indices=Slider(0, range=0..100), Wrap=True)
panel_9 = Panel("""2
3""")
item_55 = ListItem(List=ins, Index=panel_9, Wrap=True)
shift = ShiftList(List=item_55, Shift=1, Wrap=True)
replace_3 = ReplaceItems(List=ins, Item=shift, Indices=panel_9, Wrap=False)
pline = PolyLine(Vertices=replace_3, Closed=False)
explode_9 = Explode(Curve=pline, Recursive=True)  # -> Segments, Vertices
cull_i = CullIndex(List=explode_9.Segments, Indices=Slider(4, range=0..10), Wrap=True)
divide_3 = DivideCurve(Curve=cull_i, Count=Slider(2, range=0..10), Kinks=False)  # -> Points, Tangents, Parameters
pt_13 = Point(flatten(divide_3.Points))
item_56 = ListItem(List=divide_3.Points, Index=Slider(1, range=0..1), Wrap=True)
neg_12 = Negative(Value=Slider(2000, range=0..10000))
cullpt = CullDuplicates(Points=pt_13, Tolerance=0.1, CullMode=3)  # -> Points, Indices, Valence
Z = UnitZ(Factor=neg_12)
move_11 = Move(Geometry=item_56, Motion=Z)  # -> flatten(Geometry), Transform
panel_10 = Panel("""1
3
5
7
10
12
14
16""")
replace_4 = ReplaceItems(List=cullpt.Points, Item=move_11.Geometry, Indices=panel_10, Wrap=False)
pline_2 = PolyLine(Vertices=replace_4, Closed=False)
explode_10 = Explode(Curve=pline_2, Recursive=True)  # -> Segments, Vertices
panel_11 = Panel("""1
16""")
move_12 = Move(Geometry=flatten([end_4.End, end_5.End, end_4.End]), Motion=multiplication_5)  # -> graft(Geometry), Transform
panel_12 = Panel("""7
8
9""")
item_57 = ListItem(List=explode_10.Vertices, Index=panel_11, Wrap=True)
ln_23 = Line(StartPoint=item_57, EndPoint=move_12.Geometry)  # -> flatten(Line)
cull_i_2 = CullIndex(List=explode_10.Segments, Indices=panel_12, Wrap=True)
panel_13 = Panel("""7
10""")
panel_14 = Panel("""0
3""")
item_58 = ListItem(List=flatten(explode_2.Vertices), Index=0, Wrap=True)  # -> Item, Item1, Item2
item_59 = ListItem(List=replace_4, Index=panel_13, Wrap=True)
item_60 = ListItem(List=ln_23, Index=panel_14, Wrap=True)
ln_24 = Line(StartPoint=move_10.Geometry, EndPoint=item_59)
ln_25 = Line(StartPoint=move_10.Geometry, EndPoint=item_58.Item)
ln_26 = Line(StartPoint=move_10.Geometry, EndPoint=item_58.Item2)

# ----
# Extra support cable mid
ln_27 = Line(StartPoint=move.Geometry, EndPoint=move_10.Geometry)
multiplication_8 = Multiplication(A=multiplication_7, B=Slider(-2.216, range=-10..0))
move_13 = Move(Geometry=item_51.Item1, Motion=multiplication_8)  # -> Geometry, Transform
ln_28 = Line(StartPoint=move_13.Geometry, EndPoint=move.Geometry)
ln_29 = Line(StartPoint=item_58.Item, EndPoint=move_13.Geometry)
ln_30 = Line(StartPoint=item_58.Item2, EndPoint=move_13.Geometry)
# Extra support cable mid
# Extra support cables ends
# Half hexagons
# Extra support cable mid
# Extra support cables ends
# Walkway truss
# Roof
# Walkway
# Half hexagons
relay = Relay([ln_26, ln_29, ln_30])

# ----
# Extra support cables ends
number_slider_17 = Slider(7001, range=0..100000)
neg_13 = Negative(Value=number_slider_17)
pt_14 = ConstructPoint(XCoordinate=Slider(18500, range=0..100000), YCoordinate=Slider(13500, range=0..100000), ZCoordinate=0)
matrix_end_6 = ConstructPoint(XCoordinate=neg_13, YCoordinate=Slider(32600, range=0..100000), ZCoordinate=0)
pl_3 = ConstructPlane(Origin=matrix_end_6, XAxis=Vector(1, 0, 0), YAxis="0,0,1")
neg_14 = Negative(Value=Slider(17500, range=0..100000))
pl_4 = ConstructPlane(Origin=pt_14, XAxis="0,0,1", YAxis=Vector(0, 1, 0))
Y_5 = UnitY(Factor=Slider(25000, range=0..100000))
rectangle = Rectangle(Plane=pl_3, XSize=Slider(60000, range=0..100000), YSize=Slider(7500, range=0..100000), Radius=0)  # -> Rectangle, Length
rectangle_2 = Rectangle(Plane=pl_4, XSize=Slider(7500, range=0..10000), YSize=neg_14, Radius=0)  # -> Rectangle, Length
X_7 = UnitX(Factor=Slider(17500, range=0..100000))
extr = Extrude(Base=rectangle.Rectangle, Direction=Y_5)
extr_2 = Extrude(Base=rectangle_2.Rectangle, Direction=X_7)
cap = CapHoles(Brep=extr)
cap_2 = CapHoles(Brep=extr_2)

pt_15 = Point(move_13.Geometry)
preview = CustomPreview(Geometry=[cap_2, cap], Material=ColourSwatch(SwatchColor=RGB(138, 138, 138)))
# Roof beams
# Cosmetic facade setback
# Inner curve endpoint lines for windows
# Facade
# Bridge deck beams
number_slider_18 = Slider(-1500, range=-2000..0)
X_8 = UnitX(Factor=Slider(-1500, range=-2000..0))
Y_6 = UnitY(Factor=number_slider_18)
panel_15 = Panel("""5
5""")
number_slider_19 = Slider(35, range=0..100)
panel_16 = Panel("""6
7""")
curvepoint_2 = PointOnCurve(ln_2, parameter=0.69)
number_slider_20 = Slider(7, range=0..30)
panel_17 = Panel("""4
5""")
tension_cable_nodes = Point([item_19.Item3, move_5.Geometry, move_6.Geometry, item_50])
cir = Circle(Plane=PlaneXY(0, 0, 0), Radius=Slider(125, range=0..300))
ggmat = GgGSACreateMaterial(StandardStructureMaterial=0)
cir_2 = Circle(Plane=PlaneXY(0, 0, 0), Radius=Slider(220, range=0..400))
ggcp = GgCatalogueProfile(Region="EuroProfile", Serial="HE100B", Type="EP HE Beams")
item_61 = ListItem(List=curvepoint_2, Index=0, Wrap=True)  # -> Item, Item1
ggmat_2 = GgGSACreateMaterial(StandardStructureMaterial=0)
number_slider_21 = Slider(29, range=0..100)
ggcp_2 = GgCatalogueProfile(Region="EuroProfile", Serial="HE280B", Type="EP HE Beams")
panel_18 = Panel("""0
12
13
28""")
gggsabake = GgGSABakeModel(ClipSummary=False, GSAVersion="v8_7", NewFile=True)
ggmat_3 = GgGSACreateMaterial(StandardStructureMaterial=0)
ggmat_4 = GgGSACreateMaterial(StandardStructureMaterial=0)
ggcableprop = GgGSACreateCableProp(
    LowPropID=1,
    Name="cable 1",
    AE=Slider(85455000, range=0..100000000),
    Mass=Slider(0.0052, range=0..0.01),
    ThermalExp=1,
    DampingRatio=0)
ggmat_5 = GgGSACreateMaterial(StandardStructureMaterial=0)
ggmat_6 = GgGSACreateMaterial(StandardStructureMaterial=0)
cir_3 = Circle(Plane=PlaneXY(0, 0, 0), Radius=Slider(50, range=0..100))
cir_4 = Circle(Plane=PlaneXY(0, 0, 0), Radius=Slider(75, range=0..100))
ggmat_7 = GgGSACreateMaterial(StandardStructureMaterial=0)
ggsp = GgGSACreateSectionProp(Profile=cir, Name="stiff beams", Material=ggmat)
crv = Curve(relay)
ggsp_2 = GgGSACreateSectionProp(Profile=cir_2, Name="columns", Material=ggmat_2)
ggmat_8 = GgGSACreateMaterial(StandardStructureMaterial=0)
ggp2d = GgGSACreate2dFiniteElementProp(Name="Roof", Thickness=Slider(40, range=0..1000), Material=ggmat_3)
ggsp_3 = GgGSACreateSectionProp(Profile=ggcp_2, Name="Floor and roof beams", Material=ggmat_7)
ggsp_4 = GgGSACreateSectionProp(Profile=ggcp, Name="Floor and roof diagonals", Material=ggmat_4)
ggsp_5 = GgGSACreateSectionProp(Profile=cir_3, Name="Window spacers", Material=ggmat_5)
ggsp_6 = GgGSACreateSectionProp(Profile=cir_4, Name="Green roof supports", Material=ggmat_6)
cull_i_3 = CullIndex(List=crv, Indices=Slider(0, range=0..10), Wrap=True)
ggbeam = GgGSACreateBeam(Prop=ggsp_2, NodeCL=flatten(ln_2), Angle=0)
panel_19 = Panel("""11
12""")
ggp2d_2 = GgGSACreate2dFiniteElementProp(Name="floor", Thickness=Slider(40, range=0..1000), Material=ggmat_8)
panel_20 = Panel("""1
2
3
4
5
6
7
8
9
10
11
12
13
14
15
16
17
18
19""")
number_slider_22 = Slider(1, range=0..100)
ggmat_9 = GgGSACreateMaterial(StandardStructureMaterial=0)
ggp2d_3 = GgGSACreate2dFiniteElementProp(Name="Windows", Thickness=Slider(40, range=0..1000), Material=ggmat_9)
# Walkway truss
# Roof
# Roof beams
# Cosmetic facade setback
# Walkway
# Inner curve endpoint lines for windows
# Facade
# Bridge deck beams
panel_21 = Panel("""5
6
7
8
31
32""")
panel_22 = Panel("""33
34""")
panel_23 = Panel("""33
34""")
dom_2 = ConstructDomain(DomainStart=Slider(4581, range=0..10000), DomainEnd=Slider(6305, range=0..10000))
dom_3 = ConstructDomain(DomainStart=Slider(4581, range=0..10000), DomainEnd=Slider(6305, range=0..10000))
vec_2 = VectorXYZ(XComponent=0, YComponent=0, ZComponent=Slider(-1, range=-1..0))  # -> Vector, Length
grab = Grab(On=True, Strength=1, Range=Slider(1000, range=0..10000))
vec_3 = VectorXYZ(XComponent=0, YComponent=0, ZComponent=Slider(-1, range=-1..0))  # -> Vector, Length
grab_2 = Grab(On=True, Strength=1, Range=Slider(1000, range=0..10000))

Z_2 = UnitZ(Factor=Slider(-900, range=-2000..0))
number_slider_23 = Slider(77, range=0..1000)
move_14 = Move(Geometry=join, Motion=Z_2)  # -> Geometry, Transform
hframes = HorizontalFrames(Curve=move_14.Geometry, Count=number_slider_23)  # -> Frames, Parameters
divide_4 = DivideCurve(Curve=move_14.Geometry, Count=number_slider_23, Kinks=False)  # -> Points, Tangents, Parameters
deplane_7 = DeconstructPlane(Plane=hframes.Frames)  # -> Origin, XAxis, YAxis, ZAxis
line = LineSDL(Start=divide_4.Points, Direction=deplane_7.YAxis, Length=Slider(2500, range=0..10000))
line_2 = LineSDL(Start=divide_4.Points, Direction=deplane_7.YAxis, Length=Slider(-2500, range=-5000..0))
loft = Loft(Curves=line_2, Options={Adjust=False, Closed=False, LoftEnds=0, LoftSimp=0, LoftType=0, Rebuild=10, Refit=0.01})
loft_2 = Loft(Curves=line, Options={Adjust=False, Closed=False, LoftEnds=0, LoftSimp=0, LoftType=0, Rebuild=10, Refit=0.01})
merge = Merge(Data1=cull_i_2, Data2=ln_24, Data3=item_60)  # -> flatten(Result)
scx = SurfaceCurve(Surface=loft_2, Curve=merge)  # -> Curves, flatten(Points), UVPoints, Normals, Parameters, Tangents
scx_2 = SurfaceCurve(Surface=loft, Curve=merge)  # -> Curves, flatten(Points), UVPoints, Normals, Parameters, Tangents
pdecon_2 = Deconstruct(Point=scx.Points)  # -> XComponent, YComponent, ZComponent
pdecon_3 = Deconstruct(Point=scx_2.Points)  # -> XComponent, YComponent, ZComponent
sort_2 = SortList(Keys=pdecon_2.YComponent, ValuesA=scx.Points)  # -> Keys, ValuesA
sort_3 = SortList(Keys=pdecon_3.YComponent, ValuesA=scx_2.Points)  # -> Keys, ValuesA
shift_2 = ShiftList(List=sort_3.ValuesA, Shift=1, Wrap=True)
ln_31 = Line(StartPoint=sort_2.ValuesA, EndPoint=shift_2)
item_62 = ListItem(List=sort_2.ValuesA, Index=0, Wrap=True)
item_63 = ListItem(List=shift_2, Index=Slider(9, range=0..10), Wrap=True)
cull_i_4 = CullIndex(List=ln_31, Indices=Slider(9, range=0..10), Wrap=True)
ln_32 = Line(StartPoint=item_62, EndPoint=item_63)
ins_2 = InsertItems(List=cull_i_4, Item=ln_32, Indices=Slider(9, range=0..10), Wrap=True)
shift_3 = ShiftList(List=ins_2, Shift=1, Wrap=True)
midpt = CurveMiddle(Curve=[cull_i_4, ln_32])  # -> flatten(Midpoint)
item_64 = ListItem(List=cull_i_4, Index=Slider(5, range=0..10), Wrap=True)
curvepoint_3 = PointOnCurve(item_64, parameter=0.566)
replace_5 = ReplaceItems(List=midpt, Item=curvepoint_3, Indices=Slider(6, range=0..10), Wrap=False)
intcrv = Interpolate(Vertices=replace_5, Degree=3, Periodic=False, KnotStyle=1)  # -> Curve, Length, Domain
neg_15 = Negative(Value=Slider(900, range=0..10000))

end_6 = EndPoints(Curve=shift_3)  # -> Start, End
cullpt_2 = CullDuplicates(Points=end_6.Start, Tolerance=0.1, CullMode=3)  # -> Points, Indices, Valence
pt_16 = Point(end_6.End)
pt_17 = Point(cullpt_2.Points)
shift_4 = ShiftList(List=pt_16, Shift=Slider(-2, range=-2..0), Wrap=True)
shift_5 = ShiftList(List=pt_17, Shift=-1, Wrap=True)
intcrv_2 = Interpolate(Vertices=shift_5, Degree=3, Periodic=False, KnotStyle=1)  # -> Curve, Length, Domain
intcrv_3 = Interpolate(Vertices=shift_4, Degree=3, Periodic=False, KnotStyle=1)  # -> Curve, Length, Domain
rulesrf = RuledSurface(CurveA=intcrv_2.Curve, CurveB=intcrv_3.Curve)

offsets = OffsetOnSrf(Curve=intcrv.Curve, Distance=neg_15, Surface=rulesrf)
offsets_2 = OffsetOnSrf(Curve=intcrv.Curve, Distance=Slider(900, range=0..10000), Surface=rulesrf)

item_65 = ListItem(List=cull_i_4, Index=Slider(8, range=0..100), Wrap=True)
midpt_2 = CurveMiddle(Curve=ln_32)
midpt_3 = CurveMiddle(Curve=item_65)
move_15 = Move(Geometry=midpt_2, Motion=X_8)  # -> Geometry, Transform
end_7 = EndPoints(Curve=item_65)  # -> Start, End
move_16 = Move(Geometry=midpt_3, Motion=Y_6)  # -> Geometry, Transform
project_2 = Project(Geometry=move_15.Geometry, Plane=PlaneXY(0, 0, 0))  # -> Geometry, Transform
project_3 = Project(Geometry=move_16.Geometry, Plane=PlaneXY(0, 0, 0))  # -> Geometry, Transform
ln_33 = Line(StartPoint=[item_63, item_62], EndPoint=project_2.Geometry)  # -> flatten(Line)
ln_34 = Line(StartPoint=[end_7.Start, end_7.End], EndPoint=project_3.Geometry)
pt_18 = Point(flatten([project_3.Geometry, project_2.Geometry]))
relay_2 = Relay([ln_33, ln_34])
crv_2 = Curve([ln_4, ln_7, item_17, item_22, item_29, item_42, ln_18, replace_2, ln_17, ln_20, ln_21, ln_22, ln_25, ln_26, ln_27, relay_2, ln_28, relay])
dupln = RemoveDuplicateLines(Lines=crv_2, Tolerance=0.01)
end_8 = EndPoints(Curve=dupln)  # -> Start, End
ggnode = GgGSACreateOrFindNode(Location=end_8.End, DetectTol=0)
ggnode_2 = GgGSACreateOrFindNode(Location=end_8.Start, DetectTol=0)
ggnode_3 = GgGSACreateOrFindNode(Location=pt_18, DetectTol=0)
ggcable = GgGSACable(NodeA=ggnode, NodeB=ggnode_2, Property=ggcableprop, Group=1, ID=1, Name="cable 1")
pipe_4 = Pipe(
    Curve=[ln_7, item_17, item_42, ln_18, replace_2, ln_4, item_22, ln_17, ln_20, ln_22, ln_21, cull_i_3, item_29, ln_33, ln_34, ln_28],
    Radius=Slider(20, range=0..1000),
    Caps=0)
preview_2 = CustomPreview(Geometry=pipe_4, Material=ColourSwatch(SwatchColor=RGB(158, 36, 36)))
pt_19 = Point(flatten([project_2.Geometry, project_3.Geometry, move.Geometry]))
crv_3 = Curve(dupln)
cull_i_5 = CullIndex(List=flatten(dupln), Indices=panel_21, Wrap=True)
pt_20 = Point(flatten([end_7.Start, end_7.End, item_63, item_62, move_13.Geometry]))
length_line = LengthLine(Line=crv_3, Strength=10)
length_line_2 = LengthLine(Line=cull_i_5, Strength=10)

# ----
# Half hexagons
pt_21 = Point(flatten([move_10.Geometry, sort.ValuesA, move_9.Geometry, move_8.Geometry]))
cullpt_3 = CullDuplicates(Points=pt_21, Tolerance=0.1, CullMode=3)  # -> Points, Indices, Valence
panel_24 = Panel("""2
6
8
9
11""")
panel_25 = Panel("""0
1
5
7
10
12""")
item_66 = ListItem(List=cullpt_3.Points, Index=panel_25, Wrap=True)
item_67 = ListItem(List=cullpt_3.Points, Index=panel_24, Wrap=True)
merge_2 = Merge(Data1=item_66, Data2=shift_2)  # -> flatten(Result)
merge_3 = Merge(Data1=item_67, Data2=sort_2.ValuesA)  # -> flatten(Result)
pdecon_4 = Deconstruct(Point=merge_2)  # -> XComponent, YComponent, ZComponent
pdecon_5 = Deconstruct(Point=merge_3)  # -> XComponent, YComponent, ZComponent
sort_4 = SortList(Keys=pdecon_4.YComponent, ValuesA=merge_2)  # -> Keys, ValuesA
sort_5 = SortList(Keys=pdecon_5.YComponent, ValuesA=merge_3)  # -> Keys, ValuesA
panel_26 = Panel("""0
1
2
3
4
5
6""")
panel_27 = Panel("""0
1
2
3
4""")
item_68 = ListItem(List=sort_4.ValuesA, Index=panel_26, Wrap=True)
item_69 = ListItem(List=sort_5.ValuesA, Index=panel_27, Wrap=True)
pdecon_6 = Deconstruct(Point=item_68)  # -> XComponent, YComponent, ZComponent
pdecon_7 = Deconstruct(Point=item_69)  # -> XComponent, YComponent, ZComponent
neg_16 = Negative(Value=pdecon_6.XComponent)
neg_17 = Negative(Value=pdecon_7.XComponent)
sort_6 = SortList(Keys=neg_16, ValuesA=item_68)  # -> Keys, ValuesA
sort_7 = SortList(Keys=neg_17, ValuesA=item_69)  # -> Keys, ValuesA
replace_6 = ReplaceItems(List=sort_4.ValuesA, Item=sort_6.ValuesA, Indices=panel_26, Wrap=False)
replace_7 = ReplaceItems(List=sort_5.ValuesA, Item=sort_7.ValuesA, Indices=panel_27, Wrap=False)
pline_3 = PolyLine(Vertices=[replace_7, replace_6], Closed=False)
explode_11 = Explode(Curve=pline_3, Recursive=True)  # -> Segments, Vertices
len_4 = Length(Curve=explode_11.Segments)
dom_4 = ConstructDomain(DomainStart=Slider(0, range=0..100), DomainEnd=Slider(3000, range=0..10000))
inc = Includes(Value=len_4, Domain=dom_4)  # -> Includes, Deviation
cull = CullPattern(List=explode_11.Segments, CullPattern=inc.Includes)

item_70 = ListItem(List=replace_6, Index="7", Wrap=True)  # -> Item, Item1
ln_35 = Line(StartPoint=item_70.Item, EndPoint=item_70.Item1)
hframe_8 = HorizontalFrame(Curve=ln_35, Parameter=Slider(1, range=0..1))
prot_5 = RotatePlane(Plane=hframe_8, Angle=degrees(Slider(73, range=0..180)))
deplane_8 = DeconstructPlane(Plane=prot_5)  # -> Origin, XAxis, YAxis, ZAxis
arc = ArcSED(Start=item_70.Item1, End=item_70.Item, Direction=deplane_8.YAxis)  # -> Arc, Plane, Radius
item_71 = ListItem(List=replace_7, Index="5", Wrap=True)  # -> Item, Item1, Item2
project_4 = Project(Curve=arc.Arc, Brep=loft, Direction=Vector(0, 0, 1))
ccx = CurveCurve(CurveA=project_4, CurveB=line_2)  # -> flatten(Points), ParamsA, ParamsB
cps = ClosestPoints(Point=[item_71.Item, item_71.Item2], Cloud=ccx.Points, Count=Slider(1, range=0..1))  # -> flatten(ClosestPoint), CPIndex, Distance
item_72 = ListItem(List=cps.ClosestPoint, Index=0, Wrap=True)  # -> Item, Item1
ln_36 = Line(StartPoint=item_71.Item, EndPoint=item_72.Item)
ln_37 = Line(StartPoint=item_71.Item2, EndPoint=item_72.Item1)
ln_38 = Line(StartPoint=item_72.Item, EndPoint=pt_15)
ln_39 = Line(StartPoint=item_72.Item1, EndPoint=pt_15)

merge_4 = Merge(Data1=cull, Data2=cull_i_4, Data3=ln_32, Data4=[ln_36, ln_37, ln_38, ln_39])

item_73 = ListItem(List=flatten(merge_4), Index=panel_16, Wrap=True)
end_9 = EndPoints(Curve=item_73)  # -> Start, End
item_74 = ListItem(List=end_9.End, Index=Slider(1, range=0..1), Wrap=True)
ln_40 = Line(StartPoint=end_9.Start, EndPoint=curvepoint_2)
ln_41 = Line(StartPoint=item_74, EndPoint=curvepoint_2)
cull_i_6 = CullIndex(List=ln_41, Indices=Slider(0, range=0..1), Wrap=True)
cull_i_7 = CullIndex(List=ln_40, Indices=Slider(1, range=0..1), Wrap=True)
replace_8 = ReplaceItems(List=flatten(merge_4), Item=[cull_i_7, cull_i_6], Indices=panel_16, Wrap=False)
pt_22 = Point(flatten([replace_7, replace_6, move.Geometry, move_2.Geometry]))
cullpt_4 = CullDuplicates(Points=pt_22, Tolerance=0.1, CullMode=3)  # -> Points, Indices, Valence
pt_23 = Point([item_72.Item, item_72.Item1])
item_75 = ListItem(List=cullpt_4.Points, Index=panel_18, Wrap=True)
item_76 = ListItem(List=cullpt_4.Points, Index=number_slider_21, Wrap=True)
cull_i_8 = CullIndex(List=cullpt_4.Points, Indices=[panel_18, number_slider_21], Wrap=True)
ggnode_4 = GgGSACreateOrFindNode(Location=item_76, DetectTol=0)
ggnode_5 = GgGSACreateOrFindNode(Location=item_75, DetectTol=0)
ggrestraint = GgGSACreateRestraint(X=True, Y=True, Z=True, XX=invert(False), YY=invert(False), ZZ=invert(False), Nodes=ggnode_4)
ggrestraint_2 = GgGSACreateRestraint(X=True, Y=True, Z=invert(True), XX=False, YY=False, ZZ=False, Nodes=ggnode_5)
pipe_5 = Pipe(Curve=[ln_2, replace_8], Radius=Slider(158, range=0..1000), Caps=Slider(2, range=0..10))
preview_3 = CustomPreview(Geometry=pipe_5, Material=ColourSwatch(SwatchColor=RGB(51, 70, 84)))
preview_4 = CustomPreview(Geometry=[pipe_5, pipe_4], Material=ColourSwatch(SwatchColor=RGB(25, 74, 36)))
pt_24 = Point(flatten([tension_cable_nodes, item_75, cull_i_8]))
item_77 = ListItem(List=pt_24, Index=panel_22, Wrap=True)
pt_25 = Point(flatten([tension_cable_nodes, item_75, cull_i_8]))
crv_4 = Curve(flatten(merge_4))
crv_5 = Curve(flatten(merge_4))
pdecon_8 = Deconstruct(Point=pt_24)  # -> XComponent, YComponent, ZComponent
join_2 = JoinCurves(Curves=crv_4, Preserve=False)
item_78 = ListItem(List=pt_25, Index=panel_23, Wrap=True)
inc_2 = Includes(Value=pdecon_8.ZComponent, Domain=dom_2)  # -> Includes, Deviation
mpipe = MeshPipe(Curve=join_2, Radius=Slider(175, range=0..1000), Accuracy=0.2, Rotation=0, Segments=10, Caps=Slider(2, range=0..10))
anchor = Anchor(Point=item_78, Strength=10000)
cull_2 = CullPattern(List=pt_24, CullPattern=inc_2.Includes)
munion = MeshUnion(Meshes=mpipe)
pdecon_9 = Deconstruct(Point=pt_25)  # -> XComponent, YComponent, ZComponent
join_3 = JoinCurves(Curves=crv_5, Preserve=False)
pt_26 = Point(flatten([cull_2, move_13.Geometry]))
inc_3 = Includes(Value=pdecon_9.ZComponent, Domain=dom_3)  # -> Includes, Deviation
split = SplitList(List=pt_26, Index=Slider(4, range=0..10))  # -> ListA, ListB
mpipe_2 = MeshPipe(Curve=join_3, Radius=Slider(175, range=0..1000), Accuracy=0.2, Rotation=0, Segments=10, Caps=Slider(2, range=0..10))
cull_3 = CullPattern(List=pt_25, CullPattern=inc_3.Includes)
anchor_2 = Anchor(Point=[item_77, pt_19], Strength=10000)
rigidbody = RigidBody(Part=munion, Points=[pt_26, pt_20], Strength=10)  # -> RigidBody, Planes
# Cable connection points
pt_27 = Point(flatten([cull_3, move_13.Geometry]))
munion_2 = MeshUnion(Meshes=mpipe_2)
pt_28 = Point(rigidbody.Planes)
rigidbody_2 = RigidBody(Part=munion_2, Points=pt_27, Strength=10)  # -> RigidBody, Planes
pt_29 = Point(rigidbody_2.Planes)
load = Load(Point=[pt_28, pt_26], ForceVector=vec_2.Vector, Weighting=Slider(90, range=0..110))
bouncysolver = BouncySolver(
    GoalObjects=[load, anchor_2, rigidbody.RigidBody, length_line, grab],
    Reset=Button(),
    Threshold=1e-15,
    Tolerance=0.01,
    Damping=0.99,
    Iterations=Slider(2, range=0..10),
    On=Toggle(False))  # -> I, V, O
preview_5 = CustomPreview(Geometry=bouncysolver.O, Material=ColourSwatch(SwatchColor=RGB(25, 74, 36)))
load_2 = Load(Point=[pt_29, pt_27], ForceVector=vec_3.Vector, Weighting=Slider(90, range=0..110))
bouncysolver_2 = BouncySolver(
    GoalObjects=[load_2, anchor, rigidbody_2.RigidBody, length_line_2, grab_2],
    Reset=Button(),
    Threshold=1e-15,
    Tolerance=0.01,
    Damping=0.99,
    Iterations=10,
    On=Toggle(False))  # -> I, V, O
preview_6 = CustomPreview(Geometry=bouncysolver_2.O, Material=ColourSwatch(SwatchColor=RGB(25, 74, 36)))

# ----
# Walkway truss
# Roof beams
# Roof
# Inner curve endpoint lines for windows
# Walkway
# Facade
# Bridge deck beams
project_5 = Project(Curve=offsets, Brep=rulesrf, Direction=Vector(0, 0, 1))  # -> flatten(Curve)
number_slider_24 = Slider(0.5, range=0..1)
project_6 = Project(Curve=offsets_2, Brep=rulesrf, Direction=Vector(0, 0, 1))  # -> flatten(Curve)
item_79 = ListItem(List=project_5, Index=0, Wrap=True)  # -> Item, Item1, Item2, Item3, Item4
blendc = BlendCurve(CurveA=item_79.Item4, CurveB=item_79.Item3, BulgeA=number_slider_24, BulgeB=number_slider_24, Continuity=2)
join_4 = JoinCurves(Curves=[project_5, blendc], Preserve=False)
divide_5 = DivideCurve(Curve=join_4, Count=Slider(8, range=0..10), Kinks=False)  # -> Points, Tangents, Parameters
panel_28 = Panel("""4
5
6
7
8""")
shatter_8 = Shatter(Curve=join_4, Parameters=divide_5.Parameters)
item_80 = ListItem(List=divide_5.Points, Index=panel_28, Wrap=True)
number_slider_25 = Slider(4000, range=0..10000)
midpt_4 = CurveMiddle(Curve=shatter_8)
number_slider_26 = Slider(4000, range=0..10000)
panel_29 = Panel("""0
1
2""")
item_81 = ListItem(List=midpt_4, Index=panel_29, Wrap=True)
ext_2 = ExtendCurve(Curve=project_6, Type=0, Start=number_slider_25, End=number_slider_25)
ext_3 = ExtendCurve(Curve=join_4, Type=0, Start=number_slider_26, End=number_slider_26)
Z_3 = UnitZ(Factor=Slider(2300, range=0..10000))
move_17 = Move(Geometry=[ext_3, ext_2], Motion=Z_3)  # -> Geometry, Transform
item_82 = ListItem(List=flatten(move_17.Geometry), Index=0, Wrap=True)  # -> Item, Item1
Z_4 = UnitZ(Factor=Slider(2300, range=0..10000))
panel_30 = Panel("""2
3
4""")
panel_31 = Panel("""0
1
5
8""")
item_83 = ListItem(List=pt_12, Index=panel_31, Wrap=True)
rulesrf_2 = RuledSurface(CurveA=ext_2, CurveB=ext_3)
rulesrf_3 = RuledSurface(CurveA=item_82.Item, CurveB=item_82.Item1)
item_84 = ListItem(List=replace_4, Index=0, Wrap=True)
item_85 = ListItem(List=pt_12, Index=panel_30, Wrap=True)
move_18 = Move(Geometry=[item_81, item_80], Motion=Z_4)  # -> flatten(Geometry), Transform
divide_6 = DivideCurve(Curve=project_6, Count=10, Kinks=False)  # -> Points, Tangents, Parameters
Z_5 = UnitZ(Factor=Slider(2300, range=0..10000))
number_slider_27 = Slider(4, range=0..100)
Z_6 = UnitZ(Factor=Slider(2300, range=0..10000))
pt_30 = Point(graft([item_85, move_10.Geometry, item_84]))
move_19 = Move(Geometry=divide_6.Points, Motion=Z_5)  # -> Geometry, Transform
move_20 = Move(Geometry=project_6, Motion=Z_5)  # -> Geometry, Transform
pt_31 = Point(graft(item_83))
cps_2 = ClosestPoints(Point=[move_10.Geometry, item_85, item_84], Cloud=move_18.Geometry, Count=Slider(3, range=0..10))  # -> ClosestPoint, CPIndex, Distance
move_21 = Move(Geometry=join_4, Motion=Z_6)  # -> Geometry, Transform
cps_3 = ClosestPoints(Point=item_83, Cloud=move_19.Geometry, Count=Slider(3, range=0..10))  # -> ClosestPoint, CPIndex, Distance
item_86 = ListItem(List=pt_31, Index=0, Wrap=True)
pt_32 = Point(pt_15)
item_87 = ListItem(List=flatten(cps_2.ClosestPoint), Index=number_slider_27, Wrap=True)
item_88 = ListItem(List=flatten(pt_30), Index=number_slider_27, Wrap=True)
crv_cp_9 = CurveClosestPoint(Point=item_67, Curve=move_21.Geometry)  # -> graft(Point), Parameter, Distance
ln_42 = Line(StartPoint=cps_3.ClosestPoint, EndPoint=item_86)
ln_43 = Line(StartPoint=cps_2.ClosestPoint, EndPoint=pt_30)
panel_32 = Panel("""2
7
8
14""")
ln_44 = Line(StartPoint=item_87, EndPoint=item_88)
ln_45 = Line(StartPoint=crv_cp_9.Point, EndPoint=graft(item_67))  # -> flatten(Line)
cullpt_5 = CullDuplicates(Points=flatten(cps_2.ClosestPoint), Tolerance=0.1, CullMode=3)  # -> Points, Indices, Valence
crv_cp_10 = CurveClosestPoint(Point=[item_66, pt_32], Curve=move_20.Geometry)  # -> graft(Point), Parameter, Distance
cull_i_9 = CullIndex(List=flatten(ln_43), Indices=panel_32, Wrap=True)
panel_33 = Panel("""0
2
6
9""")
cull_i_10 = CullIndex(List=ln_45, Indices=Slider(3, range=0..100), Wrap=True)
panel_34 = Panel("""3
4
6
7""")
cull_i_11 = CullIndex(List=flatten(crv_cp_9.Point), Indices=Slider(3, range=0..10), Wrap=True)
ln_46 = Line(StartPoint=crv_cp_10.Point, EndPoint=graft([item_66, pt_32]))
cull_i_12 = CullIndex(List=ln_42, Indices=Slider(0, range=0..1), Wrap=True)
item_89 = ListItem(List=flatten(cullpt_5.Points), Index=panel_34, Wrap=True)
replace_9 = ReplaceItems(List=cull_i_9, Item=cull_i_10, Indices=panel_33, Wrap=False)
merge_5 = Merge(Data1=ln_46, Data2=cull_i_12)
debrep = DeconstructBrep(Brep=cap)  # -> Faces, Edges, Vertices
merge_6 = Merge(Data1=cull_i_11, Data2=item_89)
debrep_2 = DeconstructBrep(Brep=cap_2)  # -> Faces, Edges, Vertices
merge_7 = Merge(Data1=replace_9, Data2=ln_44)  # -> flatten(Result)
end_10 = EndPoints(Curve=merge_5)  # -> Start, End
item_90 = ListItem(List=debrep.Faces, Index=Slider(1, range=0..10), Wrap=True)
item_91 = ListItem(List=debrep_2.Faces, Index=Slider(1, range=0..10), Wrap=True)
pt_33 = Point(move_13.Geometry)
panel_35 = Panel("""7
11""")
pln = Plane(item_90)
item_92 = ListItem(List=flatten(cps_3.ClosestPoint), Index=panel_35, Wrap=True)
pln_2 = Plane(item_91)
plntrimsrf = PlaneTrimSurface(Surface=rulesrf_3, Plane=pln, Flip=invert(False))  # -> Trimmed, Intersected
plntrimsrf_2 = PlaneTrimSurface(Surface=rulesrf_2, Plane=pln, Flip=invert(False))  # -> Trimmed, Intersected
ln_47 = Line(StartPoint=pt_33, EndPoint=item_92)
line_3 = Line([ln_36, ln_37])
line_4 = Line(flatten([cull_i_4, ln_32]))
plntrimsrf_3 = PlaneTrimSurface(Surface=plntrimsrf.Trimmed, Plane=pln_2, Flip=invert(False))  # -> Trimmed, Intersected
join_5 = JoinCurves(Curves=[ln_47, merge_5], Preserve=False)
plntrimsrf_4 = PlaneTrimSurface(Surface=plntrimsrf_2.Trimmed, Plane=pln_2, Flip=invert(False))  # -> Trimmed, Intersected
debrep_3 = DeconstructBrep(Brep=plntrimsrf_4.Trimmed)  # -> Faces, Edges, Vertices
item_93 = ListItem(List=line_3, Index=0, Wrap=True)
item_94 = ListItem(List=debrep_3.Edges, Index=0, Wrap=True)  # -> Item, Item1, Item2, Item3
debrep_4 = DeconstructBrep(Brep=plntrimsrf_3.Trimmed)  # -> Faces, Edges, Vertices
panel_36 = Panel("""5
6""")
item_95 = ListItem(List=debrep_4.Edges, Index=0, Wrap=True)  # -> Item, Item1, Item2, Item3
ins_3 = InsertItems(List=line_4, Item=line_3, Indices=panel_36, Wrap=True)
ins_4 = InsertItems(List=line_4, Item=item_93, Indices="5", Wrap=True)
crv_cp_11 = CurveClosestPoint(Point=flatten(merge_6), Curve=item_95.Item1)  # -> Point, Parameter, Distance
end_11 = EndPoints(Curve=item_95.Item1)  # -> Start, End
crv_cp_12 = CurveClosestPoint(Point=flatten(end_10.Start), Curve=item_95.Item3)  # -> Point, Parameter, Distance
end_12 = EndPoints(Curve=item_95.Item3)  # -> Start, End
end_13 = EndPoints(Curve=item_94.Item1)  # -> Start, End
ccx_2 = CurveCurve(CurveA=line_4, CurveB=line_3)  # -> flatten(Points), ParamsA, ParamsB
crvprox = CurveProximity(CurveA=item_94.Item1, CurveB=ins_4)  # -> PointA, PointB, Distance
cullpt_6 = CullDuplicates(Points=crv_cp_12.Point, Tolerance=0.1, CullMode=3)  # -> Points, Indices, Valence
cullpt_7 = CullDuplicates(Points=crv_cp_11.Point, Tolerance=0.1, CullMode=3)  # -> Points, Indices, Valence
crvprox_2 = CurveProximity(CurveA=item_94.Item3, CurveB=ins_3)  # -> PointA, PointB, Distance
end_14 = EndPoints(Curve=item_94.Item3)  # -> Start, End
pt_34 = Point(flatten([end_12.End, end_12.Start, cullpt_6.Points]))
pt_35 = Point(flatten([end_11.Start, end_11.End, cullpt_7.Points]))
pdecon_10 = Deconstruct(Point=pt_34)  # -> XComponent, YComponent, ZComponent
pdecon_11 = Deconstruct(Point=pt_35)  # -> XComponent, YComponent, ZComponent
pt_36 = Point([crvprox_2.PointB, end_14.End, end_14.Start])
replace_10 = ReplaceItems(List=crvprox.PointB, Item=ccx_2.Points, Indices=Slider(6, range=0..10), Wrap=False)
sort_8 = SortList(Keys=pdecon_10.ZComponent, ValuesA=pt_34)  # -> Keys, ValuesA
sort_9 = SortList(Keys=pdecon_11.ZComponent, ValuesA=pt_35)  # -> Keys, ValuesA
shift_6 = ShiftList(List=pt_36, Shift=Slider(-1, range=-1..0), Wrap=True)
panel_37 = Panel("""8
7""")
intcrv_4 = Interpolate(Vertices=sort_8.ValuesA, Degree=3, Periodic=False, KnotStyle=1)  # -> Curve, Length, Domain
pt_37 = Point(flatten([replace_10, end_13.Start, end_13.End]))
intcrv_5 = Interpolate(Vertices=sort_9.ValuesA, Degree=3, Periodic=False, KnotStyle=1)  # -> Curve, Length, Domain
item_96 = ListItem(List=shift_6, Index=panel_37, Wrap=True)
panel_38 = Panel("""7
8""")
shift_7 = ShiftList(List=pt_37, Shift=Slider(1, range=-1..1), Wrap=True)
crvlenat = CurveLengthAt(Curve=intcrv_4.Curve, Point=sort_8.ValuesA, Normalized=False)  # -> Length, Parameter
crvlenat_2 = CurveLengthAt(Curve=intcrv_5.Curve, Point=sort_9.ValuesA, Normalized=False)  # -> Length, Parameter
replace_11 = ReplaceItems(List=shift_6, Item=item_96, Indices=panel_38, Wrap=False)
intcrv_6 = Interpolate(Vertices=shift_7, Degree=3, Periodic=False, KnotStyle=1)  # -> Curve, Length, Domain
intcrv_7 = Interpolate(Vertices=replace_11, Degree=3, Periodic=False, KnotStyle=1)  # -> Curve, Length, Domain
rulesrf_4 = RuledSurface(CurveA=intcrv_5.Curve, CurveB=intcrv_4.Curve)
crvlenat_3 = CurveLengthAt(Curve=intcrv_6.Curve, Point=shift_7, Normalized=False)  # -> Length, Parameter
shatter_9 = Shatter(Curve=intcrv_5.Curve, Parameters=crvlenat_2.Parameter)
shatter_10 = Shatter(Curve=intcrv_4.Curve, Parameters=crvlenat.Parameter)
# Wind load floor divisoin
crvlenat_4 = CurveLengthAt(Curve=intcrv_7.Curve, Point=replace_11, Normalized=False)  # -> Length, Parameter
shatter_11 = Shatter(Curve=intcrv_6.Curve, Parameters=crvlenat_3.Parameter)
shatter_12 = Shatter(Curve=intcrv_7.Curve, Parameters=crvlenat_4.Parameter)
rulesrf_5 = RuledSurface(CurveA=intcrv_6.Curve, CurveB=intcrv_7.Curve)
end_15 = EndPoints(Curve=[intcrv_7.Curve, intcrv_6.Curve])  # -> Start, End
Z_7 = UnitZ(Factor=Slider(-250, range=-1001..0))
extr_3 = Extrude(Base=rulesrf_4, Direction=Z_7)
ln_48 = Line(StartPoint=end_11.Start, EndPoint=end_13.Start)
Z_8 = UnitZ(Factor=Slider(250, range=0..1000))
extr_4 = Extrude(Base=rulesrf_5, Direction=Z_8)
relay_3 = Relay([ln_47, merge_5])
panel_39 = Panel("""True
False""")
panel_40 = Panel("""False
True""")
number_slider_28 = Slider(-250, range=-250..0)
number_slider_29 = Slider(-250, range=-250..0)

divide_7 = DivideCurve(Curve=intcrv_7.Curve, Count=Slider(500, range=0..1000), Kinks=False)  # -> Points, Tangents, Parameters
divide_8 = DivideCurve(Curve=intcrv_6.Curve, Count=Slider(500, range=0..1000), Kinks=False)  # -> Points, Tangents, Parameters
item_97 = ListItem(List=divide_7.Parameters, Index=Slider(166, range=0..500), Wrap=True)
item_98 = ListItem(List=divide_8.Parameters, Index=Slider(157, range=0..500), Wrap=True)
eval = EvaluateCurve(Curve=intcrv_7.Curve, Parameter=item_97)  # -> Point, Tangent, Angle
eval_2 = EvaluateCurve(Curve=intcrv_6.Curve, Parameter=item_98)  # -> Point, Tangent, Angle
ln_49 = Line(StartPoint=eval.Point, EndPoint=eval_2.Point)
vec_4 = Vector(eval.Tangent)
vec_5 = Vector(eval_2.Tangent)
shatter_13 = Shatter(Curve=intcrv_6.Curve, Parameters=item_98)
shatter_14 = Shatter(Curve=intcrv_7.Curve, Parameters=item_97)
devec = DeconstructVector(Vector=vec_4)  # -> XComponent, YComponent, ZComponent
devec_2 = DeconstructVector(Vector=vec_5)  # -> XComponent, YComponent, ZComponent
item_99 = ListItem(List=shatter_14, Index=0, Wrap=True)  # -> Item, Item1
item_100 = ListItem(List=shatter_13, Index=0, Wrap=True)  # -> Item, Item1
panel_41 = Panel([devec.XComponent, devec.YComponent])
panel_42 = Panel([devec_2.XComponent, devec_2.YComponent])
rulesrf_6 = RuledSurface(CurveA=item_99.Item, CurveB=item_100.Item)
rulesrf_7 = RuledSurface(CurveA=item_99.Item1, CurveB=item_100.Item1)

ln_50 = Line(StartPoint=end_12.Start, EndPoint=end_14.Start)
len_5 = Length(Curve=[item_99.Item, item_100.Item, item_99.Item1, item_100.Item1])
debrep_5 = DeconstructBrep(Brep=[rulesrf_6, rulesrf_7])  # -> Faces, Edges, Vertices
panel_43 = Panel(len_5)
srf = Surface(debrep_5.Faces)
crv_6 = Curve(debrep_5.Edges)
ccx_3 = CurveCurve(CurveA=graft(shatter_11), CurveB=ins_3)  # -> Points, ParamsA, ParamsB
ccx_4 = CurveCurve(CurveA=graft(shatter_12), CurveB=ins_3)  # -> Points, ParamsA, ParamsB
end_16 = EndPoints(Curve=[shatter_9, shatter_10])  # -> Start, End
line_5 = Line(flatten(relay_3))
line_6 = Line(merge_7)
pt_38 = Point(ccx_3.Points)
pt_39 = Point(ccx_4.Points)
end_17 = EndPoints(Curve=line_6)  # -> Start, End
pt_40 = Point([end_16.Start, end_16.End])
end_18 = EndPoints(Curve=line_5)  # -> Start, End
crv_7 = Curve([shatter_12, shatter_11, shatter_9, shatter_10])
# Bridge deck end supports
pt_41 = Point(end_15.End)
pt_42 = Point(end_15.Start)
cullpt_8 = CullDuplicates(Points=flatten(pt_38), Tolerance=0.1, CullMode=3)  # -> Points, Indices, Valence
# Floor beam nodes
cullpt_9 = CullDuplicates(Points=flatten(pt_39), Tolerance=0.1, CullMode=3)  # -> Points, Indices, Valence
# Roof beam nodes
cullpt_10 = CullDuplicates(Points=pt_40, Tolerance=0.1, CullMode=3)  # -> Points, Indices, Valence
cullpt_11 = CullDuplicates(Points=end_17.Start, Tolerance=0.1, CullMode=3)  # -> Points, Indices, Valence
pt_43 = Point([cullpt_9.Points, cullpt_8.Points])
cullpt_12 = CullDuplicates(Points=end_18.Start, Tolerance=0.1, CullMode=3)  # -> Points, Indices, Valence
ins_5 = InsertItems(List=line_4, Item=line_3, Indices=panel_15, Wrap=True)
cull_i_13 = CullIndex(List=cullpt_12.Points, Indices=Slider(0, range=0..100), Wrap=True)

# ----
# Floor and roof beams
join_6 = JoinCurves(Curves=shatter_10, Preserve=False)
join_7 = JoinCurves(Curves=shatter_9, Preserve=False)
join_8 = JoinCurves(Curves=shatter_11, Preserve=False)
join_9 = JoinCurves(Curves=shatter_12, Preserve=False)
divide_9 = DivideCurve(Curve=join_9, Count=number_slider_19, Kinks=False)  # -> Points, Tangents, Parameters
divide_10 = DivideCurve(Curve=join_8, Count=number_slider_19, Kinks=False)  # -> Points, Tangents, Parameters
pline_4 = PolyLine(Vertices=divide_9.Points, Closed=False)
pline_5 = PolyLine(Vertices=divide_10.Points, Closed=False)
explode_12 = Explode(Curve=pline_4, Recursive=True)  # -> Segments, Vertices
explode_13 = Explode(Curve=pline_5, Recursive=True)  # -> Segments, Vertices
pt_44 = Point(cullpt_8.Points)
pt_45 = Point(cullpt_9.Points)
cp = ClosestPoint(Point=pt_45, Cloud=explode_12.Vertices)  # -> ClosestPoint, CPIndex, Distance
divide_11 = DivideCurve(Curve=join_7, Count=number_slider_19, Kinks=False)  # -> Points, Tangents, Parameters
divide_12 = DivideCurve(Curve=join_6, Count=number_slider_19, Kinks=False)  # -> Points, Tangents, Parameters
cp_2 = ClosestPoint(Point=pt_44, Cloud=explode_13.Vertices)  # -> ClosestPoint, CPIndex, Distance
index = ItemIndex(List=explode_12.Vertices, Item=cp.ClosestPoint)
pline_6 = PolyLine(Vertices=divide_11.Points, Closed=False)
pline_7 = PolyLine(Vertices=divide_12.Points, Closed=False)
index_2 = ItemIndex(List=explode_13.Vertices, Item=cp_2.ClosestPoint)
explode_14 = Explode(Curve=pline_6, Recursive=True)  # -> Segments, Vertices
replace_12 = ReplaceItems(List=explode_12.Vertices, Item=pt_45, Indices=index, Wrap=False)
explode_15 = Explode(Curve=pline_7, Recursive=True)  # -> Segments, Vertices
replace_13 = ReplaceItems(List=explode_13.Vertices, Item=pt_44, Indices=index_2, Wrap=False)
cp_3 = ClosestPoint(Point=cullpt_11.Points, Cloud=explode_14.Vertices)  # -> ClosestPoint, CPIndex, Distance
pdecon_12 = Deconstruct(Point=replace_13)  # -> XComponent, YComponent, ZComponent
index_3 = ItemIndex(List=explode_14.Vertices, Item=cp_3.ClosestPoint)
pdecon_13 = Deconstruct(Point=replace_12)  # -> XComponent, YComponent, ZComponent
cp_4 = ClosestPoint(Point=cull_i_13, Cloud=explode_15.Vertices)  # -> ClosestPoint, CPIndex, Distance
replace_14 = ReplaceItems(List=explode_14.Vertices, Item=cullpt_11.Points, Indices=index_3, Wrap=False)
index_4 = ItemIndex(List=explode_15.Vertices, Item=cp_4.ClosestPoint)
sort_10 = SortList(Keys=pdecon_13.ZComponent, ValuesA=replace_12)  # -> Keys, ValuesA
sort_11 = SortList(Keys=pdecon_12.ZComponent, ValuesA=replace_13)  # -> Keys, ValuesA
pdecon_14 = Deconstruct(Point=flatten(replace_14))  # -> XComponent, YComponent, ZComponent
pline_8 = PolyLine(Vertices=sort_10.ValuesA, Closed=False)
pline_9 = PolyLine(Vertices=sort_11.ValuesA, Closed=False)
replace_15 = ReplaceItems(List=explode_15.Vertices, Item=cull_i_13, Indices=index_4, Wrap=False)
explode_16 = Explode(Curve=pline_8, Recursive=True)  # -> Segments, Vertices
explode_17 = Explode(Curve=pline_9, Recursive=True)  # -> Segments, Vertices
sort_12 = SortList(Keys=pdecon_14.ZComponent, ValuesA=flatten(replace_14))  # -> Keys, ValuesA
pdecon_15 = Deconstruct(Point=flatten(replace_15))  # -> XComponent, YComponent, ZComponent
pline_10 = PolyLine(Vertices=sort_12.ValuesA, Closed=False)
sort_13 = SortList(Keys=pdecon_15.ZComponent, ValuesA=flatten(replace_15))  # -> Keys, ValuesA
explode_18 = Explode(Curve=pline_10, Recursive=True)  # -> Segments, Vertices
pline_11 = PolyLine(Vertices=sort_13.ValuesA, Closed=False)
explode_19 = Explode(Curve=pline_11, Recursive=True)  # -> Segments, Vertices
rulesrf_8 = RuledSurface(CurveA=explode_18.Segments, CurveB=explode_19.Segments)

cluster = Cluster(
    L_2=pt_43,
    L_3=pt_43,
    L_4=pt_43,
    L_5=pt_43,
    L_6=pt_43,
    L_7=pt_43,
    L_8=pt_43,
    L=ins_5,
    L_9=pt_43,
    L_10=pt_43,
    L_11=pt_43,
    L_12=pt_43,
    L_13=pt_43)  # -> S, S_2, S_3, S_4, S_5, S_6, S_7, S_8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
# Segmented stiff beams
line_7 = Line([cluster.S, cluster.S_2, cluster.S_3, cluster.S_4, cluster.S_5, cluster.S_6, cluster.S_7, cluster.S_8, cluster.S_9, cluster.S_10, cluster.S_11, cluster.S_12])

# ----
# Stability diagonals
panel_44 = Panel("""FALSE
TRUE""")
panel_45 = Panel("""TRUE
FALSE""")
panel_46 = Panel("""FALSE
TRUE""")
panel_47 = Panel("""TRUE
FALSE""")
cull_4 = CullPattern(List=explode_13.Vertices, CullPattern=panel_47)
cull_5 = CullPattern(List=explode_12.Vertices, CullPattern=panel_44)
cull_6 = CullPattern(List=explode_15.Vertices, CullPattern=panel_45)
cull_7 = CullPattern(List=explode_14.Vertices, CullPattern=panel_46)
weave = Weave(Pattern=[0, 1], Stream0=cull_4, Stream1=cull_5, NullGaps=False)
weave_2 = Weave(Pattern=[0, 1], Stream0=cull_6, Stream1=cull_7, NullGaps=False)
pline_12 = PolyLine(Vertices=weave, Closed=False)
pline_13 = PolyLine(Vertices=weave_2, Closed=False)
explode_20 = Explode(Curve=pline_12, Recursive=True)  # -> Segments, Vertices
explode_21 = Explode(Curve=pline_13, Recursive=True)  # -> Segments, Vertices

pt_46 = Point(weave_2)
pt_47 = Point(weave)

pdecon_16 = Deconstruct(Point=pt_47)  # -> XComponent, YComponent, ZComponent
pdecon_17 = Deconstruct(Point=pt_46)  # -> XComponent, YComponent, ZComponent
sort_14 = SortList(Keys=pdecon_16.ZComponent, ValuesA=pt_47)  # -> Keys, ValuesA
sort_15 = SortList(Keys=pdecon_17.ZComponent, ValuesA=pt_46)  # -> Keys, ValuesA
ln_51 = Line(StartPoint=sort_15.ValuesA, EndPoint=sort_14.ValuesA)
cull_8 = CullPattern(List=ln_51, CullPattern=panel_39)
cull_9 = CullPattern(List=ln_51, CullPattern=panel_40)
ext_4 = ExtendCurve(Curve=flatten([cull_9, ln_48]), Type=0, Start=number_slider_28, End=number_slider_28)
ext_5 = ExtendCurve(Curve=cull_8, Type=ln_50, Start=number_slider_29, End=number_slider_29)
swp1 = Sweep1(Rail=intcrv_6.Curve, Sections=ext_4, Miter=1)
swp1_2 = Sweep1(Rail=intcrv_7.Curve, Sections=ext_5, Miter=1)

# ----
# facade verticals
merge_8 = Merge(Data1=ln_48, Data2=ln_50, Data3=cull_8, Data4=cull_9)
ggnode_6 = GgGSACreateOrFindNode(Location=[cullpt_9.Points, cullpt_8.Points, cullpt_10.Points], DetectTol=0)
ggnode_7 = GgGSACreateOrFindNode(Location=flatten(pt_42), DetectTol=0)
ggnode_8 = GgGSACreateOrFindNode(Location=flatten(pt_41), DetectTol=0)
merge_9 = Merge(Data1=cull, Data2=ln_38, Data3=ln_39, Data4=line_7)
item_101 = ListItem(List=merge_7, Index=panel_17, Wrap=True)
end_19 = EndPoints(Curve=item_101)  # -> Start, End
item_102 = ListItem(List=merge_7, Index=number_slider_20, Wrap=True)
bottom_green_ad_mid_span_at_center_outsi = Point(pt_33)  # "Bottom green ad mid span at center outside"
end_20 = EndPoints(Curve=item_102)  # -> Start, End
item_103 = ListItem(List=end_19.Start, Index=0, Wrap=True)  # -> Item, Item1
ln_52 = Line(StartPoint=curvepoint_2, EndPoint=end_20.Start)
ln_53 = Line(StartPoint=item_103.Item, EndPoint=item_61.Item1)
ln_54 = Line(StartPoint=item_103.Item1, EndPoint=item_61.Item)
replace_16 = ReplaceItems(List=merge_7, Item=[ln_53, ln_54], Indices=panel_17, Wrap=False)
mesh_uv = MeshSurface(Surface=rulesrf_8, UCount=Slider(1, range=0..10), VCount=Slider(1, range=0..100), Overhang=True, Equalize=False)
rulesrf_9 = RuledSurface(CurveA=explode_17.Segments, CurveB=explode_16.Segments)
ggbeam_2 = GgGSACreateBeam(Prop=ggsp, NodeCL=flatten(merge_9), Angle=0)
cull_i_14 = CullIndex(List=replace_16, Indices=number_slider_20, Wrap=True)
ins_6 = InsertItems(List=cull_i_14, Item=ln_52, Indices=panel_19, Wrap=True)
ggbeam_3 = GgGSACreateBeam(Prop=ggsp_4, NodeCL=[explode_21.Segments, explode_20.Segments], Angle=0)
ggnode_9 = GgGSACreateOrFindNode(Location=[cull_i_8, bottom_green_ad_mid_span_at_center_outsi, tension_cable_nodes, pt_23], DetectTol=0)
ggbeam_4 = GgGSACreateBeam(Prop=ggsp_5, NodeCL=merge_8, Angle=0)
ggbeam_5 = GgGSACreateBeam(Prop=ggsp_6, NodeCL=[merge_7, relay_3], Angle=0)
ggmfe = GgGSAMeshConvertFiniteElements(Prop=ggp2d, Mesh=mesh_uv, Angle=0, QuadShapeCheckAcceptance=0)  # -> StructureModelFiniteElements, StructureModelNodes, MeshIdentifyingFacesBreachingShapeChecks
mesh_uv_2 = MeshSurface(Surface=rulesrf_9, UCount=Slider(1, range=0..10), VCount=Slider(1, range=0..100), Overhang=True, Equalize=False)
ggbeam_6 = GgGSACreateBeam(Prop=ggsp_3, NodeCL=[explode_18.Segments, explode_19.Segments, explode_16.Segments, explode_17.Segments], Angle=0)
ggmfe_2 = GgGSAMeshConvertFiniteElements(Prop=ggp2d_2, Mesh=mesh_uv_2, Angle=0, QuadShapeCheckAcceptance=0)  # -> StructureModelFiniteElements, StructureModelNodes, MeshIdentifyingFacesBreachingShapeChecks
pipe_6 = Pipe(Curve=[join_5, ins_6], Radius=Slider(114, range=-1..400), Caps=Slider(2, range=0..10))
pipe_7 = Pipe(Curve=[ext_4, ext_5], Radius=Slider(30, range=0..100), Caps=0)
preview_7 = CustomPreview(Geometry=pipe_6, Material=ColourSwatch(SwatchColor=RGB(23, 128, 65)))
preview_8 = CustomPreview(Geometry=[extr_4, extr_3, pipe_7], Material=ColourSwatch(SwatchColor=RGB(115, 115, 115)))
preview_9 = CustomPreview(Geometry=[swp1_2, swp1], Material=ColourSwatch(SwatchColor=RGBA(44, 66, 176, 160)))
item_104 = ListItem(List=flatten(merge_8), Index=Slider(1, range=0..40), Wrap=True)
cull_i_15 = CullIndex(List=flatten(merge_8), Indices=panel_20, Wrap=True)
item_105 = ListItem(List=flatten(merge_8), Index=panel_20, Wrap=True)
end_21 = EndPoints(Curve=cull_i_15)  # -> Start, End
shift_8 = ShiftList(List=item_105, Shift=1, Wrap=True)
pdecon_18 = Deconstruct(Point=end_21.End)  # -> XComponent, YComponent, ZComponent
rulesrf_10 = RuledSurface(CurveA=item_105, CurveB=shift_8)
sort_16 = SortList(Keys=pdecon_18.ZComponent, ValuesA=end_21.End)  # -> Keys, ValuesA
cp_5 = ClosestPoint(Point=sort_16.ValuesA, Cloud=end_21.Start)  # -> ClosestPoint, CPIndex, Distance
cull_i_16 = CullIndex(List=rulesrf_10, Indices=Slider(0, range=0..100), Wrap=True)
ln_55 = Line(StartPoint=cp_5.ClosestPoint, EndPoint=sort_16.ValuesA)
shift_9 = ShiftList(List=ln_55, Shift=1, Wrap=True)
rulesrf_11 = RuledSurface(CurveA=ln_55, CurveB=shift_9)
cull_i_17 = CullIndex(List=rulesrf_11, Indices=Slider(18, range=0..100), Wrap=True)
mesh_uv_3 = MeshSurface(Surface=[cull_i_16, cull_i_17], UCount=number_slider_22, VCount=number_slider_22, Overhang=True, Equalize=False)
# Walkway truss
ggmfe_3 = GgGSAMeshConvertFiniteElements(Prop=ggp2d_3, Mesh=mesh_uv_3, Angle=0, QuadShapeCheckAcceptance=0)  # -> StructureModelFiniteElements, StructureModelNodes, MeshIdentifyingFacesBreachingShapeChecks

# ==== cluster Cluster
L = ClusterInput()
item = ListItem(List=L, Index=0, Wrap=True)  # -> Item, Item1, Item2, Item3, Item4, Item5, Item6, Item7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
L_2 = ClusterInput()
L_3 = ClusterInput()
L_4 = ClusterInput()
L_5 = ClusterInput()
L_6 = ClusterInput()
L_7 = ClusterInput()
L_8 = ClusterInput()
L_9 = ClusterInput()
L_10 = ClusterInput()
L_11 = ClusterInput()
L_12 = ClusterInput()
L_13 = ClusterInput()
panel = Panel("""0
12""")
panel_2 = Panel("""1
13""")
panel_3 = Panel("""2
14""")
panel_4 = Panel("""3
15""")
panel_5 = Panel("""4
16""")
panel_6 = Panel("""5
17""")
panel_7 = Panel("""6
18""")
panel_8 = Panel("""7
18""")
panel_9 = Panel("""8
19""")
panel_10 = Panel("""9
20""")
panel_11 = Panel("""10
21""")
panel_12 = Panel("""11
22""")
item_2 = ListItem(List=L_2, Index=panel, Wrap=True)
item_3 = ListItem(List=L_3, Index=panel_2, Wrap=True)
item_4 = ListItem(List=L_4, Index=panel_3, Wrap=True)
item_5 = ListItem(List=L_5, Index=panel_4, Wrap=True)
item_6 = ListItem(List=L_6, Index=panel_5, Wrap=True)
item_7 = ListItem(List=L_7, Index=panel_6, Wrap=True)
item_8 = ListItem(List=L_8, Index=panel_7, Wrap=True)
item_9 = ListItem(List=L_9, Index=panel_8, Wrap=True)
item_10 = ListItem(List=L_10, Index=panel_9, Wrap=True)
item_11 = ListItem(List=L_11, Index=panel_10, Wrap=True)
item_12 = ListItem(List=L_12, Index=panel_11, Wrap=True)
item_13 = ListItem(List=L_13, Index=panel_12, Wrap=True)
crvlenat = CurveLengthAt(Curve=item.Item, Point=item_2, Normalized=False)  # -> Length, Parameter
crvlenat_2 = CurveLengthAt(Curve=item.Item1, Point=item_3, Normalized=False)  # -> Length, Parameter
crvlenat_3 = CurveLengthAt(Curve=item.Item2, Point=item_4, Normalized=False)  # -> Length, Parameter
crvlenat_4 = CurveLengthAt(Curve=item.Item3, Point=item_5, Normalized=False)  # -> Length, Parameter
crvlenat_5 = CurveLengthAt(Curve=item.Item4, Point=item_6, Normalized=False)  # -> Length, Parameter
crvlenat_6 = CurveLengthAt(Curve=item.Item5, Point=item_7, Normalized=False)  # -> Length, Parameter
crvlenat_7 = CurveLengthAt(Curve=item.Item6, Point=item_8, Normalized=False)  # -> Length, Parameter
crvlenat_8 = CurveLengthAt(Curve=item.Item7, Point=item_9, Normalized=False)  # -> Length, Parameter
crvlenat_9 = CurveLengthAt(Curve=item.Item8, Point=item_10, Normalized=False)  # -> Length, Parameter
crvlenat_10 = CurveLengthAt(Curve=item.Item9, Point=item_11, Normalized=False)  # -> Length, Parameter
crvlenat_11 = CurveLengthAt(Curve=item.Item10, Point=item_12, Normalized=False)  # -> Length, Parameter
crvlenat_12 = CurveLengthAt(Curve=item.Item11, Point=item_13, Normalized=False)  # -> Length, Parameter
shatter = Shatter(Curve=item.Item, Parameters=crvlenat.Parameter)
shatter_2 = Shatter(Curve=item.Item1, Parameters=crvlenat_2.Parameter)
shatter_3 = Shatter(Curve=item.Item2, Parameters=crvlenat_3.Parameter)
shatter_4 = Shatter(Curve=item.Item3, Parameters=crvlenat_4.Parameter)
shatter_5 = Shatter(Curve=item.Item4, Parameters=crvlenat_5.Parameter)
shatter_6 = Shatter(Curve=item.Item5, Parameters=crvlenat_6.Parameter)
shatter_7 = Shatter(Curve=item.Item6, Parameters=crvlenat_7.Parameter)
shatter_8 = Shatter(Curve=item.Item7, Parameters=crvlenat_8.Parameter)
shatter_9 = Shatter(Curve=item.Item8, Parameters=crvlenat_9.Parameter)
shatter_10 = Shatter(Curve=item.Item9, Parameters=crvlenat_10.Parameter)
shatter_11 = Shatter(Curve=item.Item10, Parameters=crvlenat_11.Parameter)
shatter_12 = Shatter(Curve=item.Item11, Parameters=crvlenat_12.Parameter)
S = ClusterOutput(shatter)
S_2 = ClusterOutput(shatter_2)
S_3 = ClusterOutput(shatter_3)
S_4 = ClusterOutput(shatter_4)
S_5 = ClusterOutput(shatter_5)
S_6 = ClusterOutput(shatter_6)
S_7 = ClusterOutput(shatter_7)
S_8 = ClusterOutput(shatter_8)
S_9 = ClusterOutput(shatter_9)
S_10 = ClusterOutput(shatter_10)
S_11 = ClusterOutput(shatter_11)
S_12 = ClusterOutput(shatter_12)
